# Grasshopper definition M3.320.gh (Grasshopper 1.0.8)

number_slider = Slider(11, range=0..20)
number_slider_2 = Slider(10, range=0..20)
number_slider_3 = Slider(14, range=0..20)

subtraction = Subtraction(A=number_slider_2, B=1)
range = Range(Domain=Domain(0, 1), Steps=subtraction)
graph_mapper = GraphMapper(range, x0=0, x1=1, y0=0, y1=1, container_name="Bezier", cpx=[0, 0.2568837106, 0.75, 1], cpy=[0, 0.7189985514, 0.75, 0])
series = Series(Start=0, Step=Slider(2, range=0..2.5), Count=number_slider_2)
remap_numbers = RemapNumbers(Value=number_slider_2, Source=Domain(0, 1), Target=graph_mapper)  # -> Mapped, Clipped
construct_point = ConstructPoint(XCoordinate=series, YCoordinate=remap_numbers.Mapped, ZCoordinate=0)

subtraction_2 = Subtraction(A=number_slider, B=1)
range_2 = Range(Domain=Domain(0, 1), Steps=subtraction_2)
graph_mapper_2 = GraphMapper(
    range_2,
    x0=0,
    x1=1,
    y0=0,
    y1=1,
    container_name="Bezier",
    cpx=[0, 0.143777594, 0.7878732085, 1],
    cpy=[1, 0.3469008207, 0.2534816861, 1])
series_2 = Series(Start=Slider(-10, range=-10..2.5), Step=Slider(1.8, range=0..2.5), Count=number_slider)
remap_numbers_2 = RemapNumbers(Value=number_slider, Source=Domain(0, 1), Target=graph_mapper_2)  # -> Mapped, Clipped
construct_point_2 = ConstructPoint(XCoordinate=series_2, YCoordinate=remap_numbers_2.Mapped, ZCoordinate=0)

subtraction_3 = Subtraction(A=number_slider_3, B=1)
range_3 = Range(Domain=Domain(0, 1), Steps=subtraction_3)
graph_mapper_3 = GraphMapper(
    range_3,
    x0=0,
    x1=1,
    y0=0,
    y1=1,
    container_name="Sinc",
    Equation_X0=0.2414316386,
    Equation_X1=0.6,
    Equation_Y0=0.7673410773,
    Equation_Y1=0.3)
series_3 = Series(Start=Slider(2.5, range=-10..2.5), Step=Slider(1.4, range=0..2.5), Count=number_slider_3)
remap_numbers_3 = RemapNumbers(Value=number_slider_3, Source=Domain(0, 1), Target=graph_mapper_3)  # -> Mapped, Clipped
construct_point_3 = ConstructPoint(XCoordinate=series_3, YCoordinate=remap_numbers_3.Mapped, ZCoordinate=0)

unit_z = UnitZ(Factor=Slider(0.4, range=0..2.5))
curve = Curve(<curve referenced from the Rhino model>)
offset_curve = OffsetCurve(Curve=curve, Distance=Slider(2, range=-10..10), Corners=1)
interpolate = Interpolate(Vertices=construct_point, Degree=3, Periodic=False, KnotStyle=1)  # -> Curve, Length, Domain
extrude = Extrude(Base=offset_curve, Direction=unit_z)
interpolate_2 = Interpolate(Vertices=construct_point_2, Degree=3, Periodic=False, KnotStyle=1)  # -> Curve, Length, Domain
interpolate_3 = Interpolate(Vertices=construct_point_3, Degree=3, Periodic=False, KnotStyle=1)  # -> Curve, Length, Domain
unit_z_2 = UnitZ(Factor=Slider(7, range=0..40))
brep = Brep(extrude)
move = Move(Geometry=interpolate_2.Curve, Motion=unit_z_2)  # -> Geometry, Transform
unit_z_3 = UnitZ(Factor=Slider(16, range=0..40))
deconstruct_brep = DeconstructBrep(Brep=brep)  # -> Faces, Edges, Vertices
unit_x = UnitX(Factor=Slider(11, range=-20..20))
move_2 = Move(Geometry=interpolate_3.Curve, Motion=unit_z_3)  # -> Geometry, Transform
move_3 = Move(Geometry=move.Geometry, Motion=unit_x)  # -> Geometry, Transform
unit_x_2 = UnitX(Factor=Slider(-2, range=-10..20))
boundary_surfaces = BoundarySurfaces(Edges=deconstruct_brep.Edges)
unit_y = UnitY(Factor=Slider(-7, range=-20..20))
move_4 = Move(Geometry=move_2.Geometry, Motion=unit_x_2)  # -> Geometry, Transform
unit_y_2 = UnitY(Factor=Slider(-2, range=-10..10))
move_5 = Move(Geometry=move_3.Geometry, Motion=unit_y)  # -> Geometry, Transform
curve_2 = Curve(move_5.Geometry)
move_6 = Move(Geometry=move_4.Geometry, Motion=unit_y_2)  # -> Geometry, Transform
curve_3 = Curve(move_6.Geometry)
curve_4 = Curve([<curve referenced from the Rhino model> x3])

number_slider_4 = Slider(1.1, range=0..2.5)
loft = Loft(Curves=curve_4, Options={Adjust=False, Closed=False, LoftEnds=0, LoftSimp=0, LoftType=0, Rebuild=10, Refit=0.01})
unit_z_4 = UnitZ(Factor=number_slider_4)
contour = Contour(Shape=loft, Point=Point(0, 0, 0), Direction=Vector(0, 0, 1), Distance=number_slider_4)
extrude_2 = Extrude(Base=contour, Direction=unit_z_4)
unit_y_3 = UnitY(Factor=Slider(4, range=0..5))
extrude_3 = Extrude(Base=extrude_2, Direction=unit_y_3)

curve_5 = Curve([<curve referenced from the Rhino model> x3])
number_slider_5 = Slider(1, range=0..2.5)
loft_2 = Loft(Curves=curve_5, Options={Adjust=False, Closed=False, LoftEnds=0, LoftSimp=0, LoftType=0, Rebuild=10, Refit=0.01})
unit_z_5 = UnitZ(Factor=number_slider_5)
contour_2 = Contour(Shape=loft_2, Point=Point(0, 0, 0), Direction=Vector(0, 0, 1), Distance=number_slider_5)
extrude_4 = Extrude(Base=contour_2, Direction=unit_z_5)
unit_y_4 = UnitY(Factor=Slider(5, range=0..5))
extrude_5 = Extrude(Base=extrude_4, Direction=unit_y_4)
